# Dynamo graph anchor_05_number_anchors.dyn "dump_assembly" (Dynamo 2.18.1.5096)

python_script = Python()  # CPython3
# ---------- python_script.python (40 lines) ----------
import clr, importlib, os, sys

clr.AddReference("AecBaseMgd")
clr.AddReference("AeccDbMgd")
clr.AddReference("acmgd")
clr.AddReference("acdbmgd")
clr.AddReference("AecPropDataMgd")

try:
    _LIB_ROOT = os.path.dirname(
        os.path.dirname(os.path.dirname(os.path.abspath(__file__)))
    )
except NameError:
    _LIB_ROOT = os.environ.get("ARHYZ_LIB_ROOT", r"C:\Arhyz\automation\scripts\anchor")

_AUTOMATION_ROOT = os.path.dirname(_LIB_ROOT)

if _LIB_ROOT not in sys.path:
    sys.path.insert(0, _LIB_ROOT)
if _AUTOMATION_ROOT not in sys.path:
    sys.path.insert(0, _AUTOMATION_ROOT)

# Drop this package so the next import reloads every submodule fresh in
# dependency order (see ditch_04_build_cross/launcher.py for the rationale).
for _name in [m for m in list(sys.modules) if m.startswith("anchor_")]:
    del sys.modules[_name]
for _name in sorted(
    [m for m in sys.modules if m.startswith("civil")],
    reverse=True,
):
    try:
        importlib.reload(sys.modules[_name])
    except Exception:
        pass

from anchor_05_number_anchors.builder import AnchorNumberBuilder

# Number all anchor circles + tag each with the Arhyz_Anchor property set.
# Returns the log file path.
OUT = AnchorNumberBuilder().run()
# ----------------------------------------
