# Dynamo graph anchor_exp_smooth_grid.dyn "dump_assembly" (Dynamo 2.18.1.5096)

python_script = Python()  # CPython3
# ---------- python_script.python (37 lines) ----------
import clr, importlib, os, sys

clr.AddReference("AecBaseMgd")
clr.AddReference("AeccDbMgd")
clr.AddReference("acmgd")
clr.AddReference("acdbmgd")

try:
    _LIB_ROOT = os.path.dirname(
        os.path.dirname(os.path.dirname(os.path.abspath(__file__)))
    )
except NameError:
    _LIB_ROOT = os.environ.get("ARHYZ_LIB_ROOT", r"C:\Arhyz\automation\scripts\anchor")

_AUTOMATION_ROOT = os.path.dirname(_LIB_ROOT)

if _LIB_ROOT not in sys.path:
    sys.path.insert(0, _LIB_ROOT)
if _AUTOMATION_ROOT not in sys.path:
    sys.path.insert(0, _AUTOMATION_ROOT)

# Drop every anchor_* module so the next import reloads them fresh.
for _name in [m for m in list(sys.modules) if m.startswith("anchor_")]:
    del sys.modules[_name]
for _name in sorted(
    [m for m in sys.modules if m.startswith("civil")],
    reverse=True,
):
    try:
        importlib.reload(sys.modules[_name])
    except Exception:
        pass

from anchor_exp_smooth_grid.builder import SmoothGridBuilder

# Experiment: smooth-median grid + anchors on inf_md_anchor_grid2/_pts2.
OUT = SmoothGridBuilder().run()
# ----------------------------------------
