# Dynamo graph ditch_04_build_cross.dyn "dump_assembly" (Dynamo 2.18.1.5096)

python_script = Python()  # CPython3
# ---------- python_script.python (45 lines) ----------
import clr, importlib, os, sys

clr.AddReference("AecBaseMgd")
clr.AddReference("AeccDbMgd")
clr.AddReference("acmgd")
clr.AddReference("acdbmgd")

try:
    _LIB_ROOT = os.path.dirname(
        os.path.dirname(os.path.dirname(os.path.abspath(__file__)))
    )
except NameError:
    _LIB_ROOT = os.environ.get("ARHYZ_LIB_ROOT", r"C:\Arhyz\automation\scripts\ditch")

_AUTOMATION_ROOT = os.path.dirname(_LIB_ROOT)

if _LIB_ROOT not in sys.path:
    sys.path.insert(0, _LIB_ROOT)
if _AUTOMATION_ROOT not in sys.path:
    sys.path.insert(0, _AUTOMATION_ROOT)

# Drop both this package and ditch_core (the imported geometry) from
# sys.modules so the next import reloads every submodule fresh in dependency
# order. importlib.reload() in name order rebinds `from .x import y` against stale
# modules when a dependant reloads before its dependency — deleting avoids that.
for _name in [
    m
    for m in list(sys.modules)
    if m.startswith("ditch_04_build_cross") or m.startswith("ditch_core")
]:
    del sys.modules[_name]
for _name in sorted(
    [m for m in sys.modules if m.startswith("civil")],
    reverse=True,
):
    try:
        importlib.reload(sys.modules[_name])
    except Exception:
        pass

from ditch_04_build_cross.builder import MarkedDitchBuilder

# Main script: project every marker circle (inf_md_marker) onto the alignment and
# build a cross-ditch at each. No selection / IN[0] needed.
OUT = MarkedDitchBuilder().run()
# ----------------------------------------
