# Dynamo graph draw_gabion_view.dyn (Dynamo 2.18.1.5096)

string = StringInput("НК-1А-5")  # graph input
python_script = Python(IN[0]=string)  # CPython3
# ---------- python_script.python (37 lines) ----------
import clr, os, sys

clr.AddReference("AecBaseMgd")
clr.AddReference("AeccDbMgd")
clr.AddReference("acmgd")
clr.AddReference("acdbmgd")

try:
    _LIB_ROOT = os.path.dirname(os.path.dirname(os.path.abspath(__file__)))
except NameError:
    _LIB_ROOT = os.environ.get("ARHYZ_LIB_ROOT", r"C:\Arhyz\automation\scripts")

_AUTOMATION_ROOT = os.path.dirname(_LIB_ROOT)

if _LIB_ROOT not in sys.path:
    sys.path.insert(0, _LIB_ROOT)
if _AUTOMATION_ROOT not in sys.path:
    sys.path.insert(0, _AUTOMATION_ROOT)

# Purge cached package modules instead of importlib.reload: reload() re-imports a
# module's dependencies from sys.modules in whatever order the reload loop runs, so
# builder could bind a stale BlockManager before blocks reloaded. Deleting the
# entries forces the import below to rebuild the whole tree in dependency order.
for _name in [
    m
    for m in list(sys.modules)
    if m == "draw_gabion_view"
    or m.startswith("draw_gabion_view.")
    or m == "civil"
    or m.startswith("civil.")
    or m == "paths"
]:
    del sys.modules[_name]

from draw_gabion_view.builder import GabionViewBuilder

OUT = GabionViewBuilder(IN[0]).run()
# ----------------------------------------
