# Dynamo graph help_delete_polyline2d_on_polyline3d.dyn "clear_inf" (Dynamo 2.18.1.5096)

python_script = Python()  # CPython3
# ---------- python_script.python (40 lines) ----------
import clr, importlib, os, sys

clr.AddReference("acmgd")
clr.AddReference("acdbmgd")

try:
    _LIB_ROOT = os.path.dirname(os.path.dirname(os.path.abspath(__file__)))
except NameError:
    _LIB_ROOT = os.environ.get("ARHYZ_LIB_ROOT", r"C:\Arhyz\automation\scripts")
_AUTOMATION_ROOT = os.path.dirname(_LIB_ROOT)
if _LIB_ROOT not in sys.path:
    sys.path.insert(0, _LIB_ROOT)
if _AUTOMATION_ROOT not in sys.path:
    sys.path.insert(0, _AUTOMATION_ROOT)

for _name in sorted(
    [m for m in sys.modules if m.startswith("help_delete_polyline2d_on_polyline3d")],
    reverse=True,
):
    try:
        importlib.reload(sys.modules[_name])
    except Exception:
        pass

from help_delete_polyline2d_on_polyline3d.builder import DeleteFlatPolylineBuilder


# Layer whitelists default to layers_config.json (UTF-8 sidecar) so Cyrillic
# layer names stay out of the .dyn. Wiring IN[2]/IN[3] (comma-separated
# strings) overrides the config; leaving them unset => use the config.
def _split(s):
    return [p for p in (s or "").split(",") if p.strip()]


_tol = float(IN[0]) if IN and len(IN) > 0 and IN[0] else 0.001
_min_ov = float(IN[1]) if IN and len(IN) > 1 and IN[1] else 0.1
_layers_2d = _split(IN[2]) if IN and len(IN) > 2 and IN[2] else None
_layers_3d = _split(IN[3]) if IN and len(IN) > 3 and IN[3] else None

OUT = DeleteFlatPolylineBuilder(_tol, _min_ov, _layers_2d, _layers_3d).run()
# ----------------------------------------
